# Grasshopper definition installer.gh (Grasshopper 1.0.7)
# plug-ins: Bifocals

gallery = ImageGallery(CycleDelay=30, Randomize=False, UseLocalImages=True, UseRemoteImages=True)

# ---- group: GhPython Script
rir_install = TAECRIRToolkitInstaller(install=Toggle(False))  # -> out, message
# ---------- rir_install: Python ----------
__author__ = "ykish"
__version__ = "2023.11.29"

import rhinoscriptsyntax as rs

__author__ = "ykish"
__version__ = "2023.11.24"


ghenv.Component.Name = 'TAEC RIR Toolkit Installer'
ghenv.Component.NickName = 'RIR Install'

ghenv.Component.Category = 'TAECRIRToolkit'


import clr
clr.AddReference("System.Net")
import os
import io
import subprocess
import System.Net
import System.Windows.Forms
import shutil
from distutils import dir_util
import Rhino
from Rhino.RhinoApp import Version as RHINO_VERSION
from Grasshopper.Folders import UserObjectFolders, DefaultAssemblyFolder
from Grasshopper.Kernel import GH_RuntimeMessageLevel as Message
from System import Array
from System.Net import WebClient
from System.IO import Path, Directory
import zipfile
import json

def remove_directory(path):
    """ Remove a directory and all its contents """
    if os.path.exists(path):
        shutil.rmtree(path)
        message = "Removed directory: {}".format(path)
    else:
        message = "Directory not found: {}".format(path)
    return message

def remove_from_python_search_paths(path):
    """ Remove a path from Rhino's Python script search paths """
    current_paths = list(Rhino.Runtime.PythonScript.SearchPaths)
    if path in current_paths:
        current_paths.remove(path)
        Rhino.Runtime.PythonScript.SearchPaths = Array[str](current_paths)
        message = "Removed from Python search paths: {}".format(path)
    else:
        message = "Path not found in Python search paths: {}".format(path)
    return message


def get_latest_release_zip_url(repo):
    """GitHubのAPIを使用して最新のリリースのZIPファイルのURLを取得する"""
    api_url = "https://api.github.com/repos/{}/releases/latest".format(repo)
    client = WebClient()
    client.Headers.Add("User-Agent", "request")
    release_info = client.DownloadString(api_url)
    release_data = json.loads(release_info)
    return release_data["zipball_url"]
    
def download_zip_from_url(url, save_dir):
    """指定されたURLからZIPファイルをダウンロードし、指定されたディレクトリに保存する"""
    client = WebClient()
    client.Headers.Add("User-Agent", "request")
    filename = os.path.join(save_dir, "latest_release.zip")
    client.DownloadFile(url, filename)
    return filename

def unzip_file(zip_filepath, dest_dir, folders_to_extract, specific_destinations,tool_name):
    with zipfile.ZipFile(zip_filepath, 'r') as zip_ref:
        for item in zip_ref.infolist():
            path_parts = item.filename.split('/')
            # 2番目のフォルダ名を取得（トップレベルフォルダが1つのみの場合）
            second_level_folder = path_parts[1] if len(path_parts) > 1 else None

            # 2番目のフォルダが特定のフォルダに属する場合、適切なディレクトリに解凍
            if second_level_folder in folders_to_extract:
                destination = specific_destinations.get(second_level_folder, dest_dir)

                # 完全な解凍先のパスを生成
                full_path = os.path.join(destination, *path_parts[1:])

                # ディレクトリの作成
                if item.filename.endswith('/') and not os.path.isdir(full_path):
                    print(full_path)
                    os.makedirs(full_path)
                # ファイルの解凍
                elif not item.filename.endswith('/'):
                    # 解凍先ディレクトリが存在しない場合は作成
                    if not os.path.exists(os.path.dirname(full_path)):
                        os.makedirs(os.path.dirname(full_path))
                    # 元のフォルダ構造を無視して特定のパスにファイルを解凍
                    with zip_ref.open(item) as source, open(full_path, 'wb') as target:
                        shutil.copyfileobj(source, target)

    # ZIPファイルの解凍が完了した後、特定のフォルダ名を変更
    if 'userObjects' in folders_to_extract:
        original_path = os.path.join(specific_destinations['userObjects'], 'userObjects')
        new_path = os.path.join(specific_destinations['userObjects'], tool_name)
        if os.path.exists(original_path) and not os.path.exists(new_path):
            os.rename(original_path, new_path)
    os.remove(zip_filepath)
    
    
    
if _install:
    message =[]
    # リポジトリのユーザー名/名前
    repo = "yishizu/TAEC_RIR_PythonToolkit"
    tool_name = "RIR_PythonToolkit"
    # 保存するディレクトリ
    save_dir = os.path.join(os.environ["LOCALAPPDATA"], "GEL", tool_name)
    my_package_dir = os.path.join(save_dir,"my_package")
    if not os.path.exists(save_dir):
        os.makedirs(save_dir)
    else:
        message.append(remove_directory(save_dir))
        message.append(remove_from_python_search_paths(my_package_dir))
        
    if not os.path.exists(save_dir):
        os.makedirs(save_dir)
    # 最新のリリースZIPのURLを取得
    latest_release_url = get_latest_release_zip_url(repo)
    print(latest_release_url)
    ver = latest_release_url.split('/')[-1].lstrip('v')
    ghenv.Component.Message = ver
    
    userObject_dir =""
    for folder in UserObjectFolders:
        if "UserObjects" in folder:
            userObject_dir = folder
    
    folders_to_extract = {'my_package', 'gh_scripts', 'data','userObjects'}
    specific_destinations = {
        'my_package': save_dir,
        'gh_scripts': save_dir,
        'data':save_dir,
        'userObjects': userObject_dir
    }
    # ZIPファイルをダウンロードして解凍
    zip_path = download_zip_from_url(latest_release_url, save_dir)
    message.append('zip file downloaded...')
    #print(zip_path)
    unzip_file(zip_path, save_dir,folders_to_extract,specific_destinations,tool_name)
    message.append('unzip...')
    current_paths = list(Rhino.Runtime.PythonScript.SearchPaths)
    new_path =  os.path.join(save_dir,"my_package")
    if new_path not in current_paths:
        current_paths.append(new_path)
        Rhino.Runtime.PythonScript.SearchPaths = Array[str](current_paths)
    print(Rhino.Runtime.PythonScript.SearchPaths)
    message.append('Added Path...')
    message.append(Rhino.Runtime.PythonScript.SearchPaths[-1])
    message.append("Success!!!")
# ---------- end rir_install ----------

# ----
# Color Format
# Input
data = Data(1)
# Method
data_2 = Data(1)
# Output
data_3 = Data(1)
# Display
data_4 = Data(1)
# Unuse
data_5 = Data(1)
