# Grasshopper definition test_data_processor.gh (Grasshopper 1.0.7)
# plug-ins: Bifocals

gallery = ImageGallery(CycleDelay=30, Randomize=False, UseLocalImages=True, UseRemoteImages=True)
# Get Symbol Name From CSV
python = GhPythonScript()  # -> out, a
# ---------- python: Python ----------
__author__ = "ykish"
__version__ = "2023.11.29"

import rhinoscriptsyntax as rs
from repository.data_processor import find_row_by_name

a = find_row_by_name('Desk','BlockName')
# ---------- end python ----------
python_2 = GhPythonScript(dict=python.a)  # -> out, familyType, blockName, category
# ---------- python_2: Python ----------
__author__ = "ykish"
__version__ = "2023.11.29"

import rhinoscriptsyntax as rs

category = dict['BuiltInCategory']
familyType = dict['FamilyType']
blockName = dict['BlockName']
# ---------- end python_2 ----------
panel = Panel(python_2.category)
panel_2 = Panel(python_2.familyType)

# ----
# Color Format
# Input
data = Data(1)
# Method
data_2 = Data(1)
# Output
data_3 = Data(1)
# Display
data_4 = Data(1)
# Unuse
data_5 = Data(1)
