# Grasshopper definition test_revit_create_familyInstance.gh (Grasshopper 1.0.7)
# plug-ins: Bifocals, Rhino.Inside for Autodesk Revit

gallery = ImageGallery(CycleDelay=30, Randomize=False, UseLocalImages=True, UseRemoteImages=True)
# Write From Library
panel = Panel("Shelf")
crv = Curve(<curve referenced from the Rhino model>)
pt = Point(<point referenced from the Rhino model>)
# Get Symbol Name From CSV
python = GhPythonScript()  # -> out, a
# ---------- python: Python ----------
__author__ = "ykish"
__version__ = "2023.11.29"

import rhinoscriptsyntax as rs
from repository.data_processor import find_row_by_name

a = find_row_by_name('Desk','BlockName')
# ---------- end python ----------
# Get Symbol in GHpython
python_2 = GhPythonScript()  # -> out, a
# ---------- python_2: Python ----------
import clr
clr.AddReference('RevitAPI')

from Autodesk.Revit.DB import BuiltInCategory,FilteredElementCollector,FamilySymbol,BuiltInParameter
from utils.rhinoinside_utils import get_active_doc


def get_built_in_category(category_name):
    try:
        # 文字列からBuiltInCategoryを取得
        category = getattr(BuiltInCategory, category_name)
        return category
    except Exception as e:
        # カテゴリが見つからない場合はNoneを返す
        return None
        
def query_family_type(doc, category, type_name):
    # 指定されたカテゴリとタイプ名に基づいてFamily Typeを取得
    collector = FilteredElementCollector(doc).OfClass(FamilySymbol).OfCategory(category)
    for elem in collector:
        if elem.get_Parameter(BuiltInParameter.ALL_MODEL_TYPE_NAME).AsString() == type_name:
            return elem
    return None
    
# 使用例
category_name = 'OST_Furniture'
category = get_built_in_category(category_name)

doc = get_active_doc()
print(query_family_type(doc,category,'GEL-Chair-一般オフィスチェア'))
# ---------- end python_2 ----------
python_3 = GhPythonScript()  # -> out, a
# ---------- python_3: Python ----------
import clr
clr.AddReference('RhinoInside.Revit')
clr.AddReference('System.Core')
clr.AddReference('RevitAPI') 
clr.AddReference('RevitAPIUI')
from RhinoInside.Revit import Revit, Convert
from Autodesk.Revit import DB
from System.Collections.Generic import List, IList
from System import Enum, Action, Func, Uri, Guid, DateTime
from Autodesk.Revit.DB import XYZ, Line as RevitLine, CurveArray, CurveArrArray,NurbSpline,BoundingBoxXYZ, Arc as RevitArc,Curve as RevitCurve,CurveLoop,CylindricalHelix, Ellipse as RevitEllipse,HermiteSpline 
from Rhino.Geometry import Arc, Circle,Point3d,Point3f, Vector3d,Vector3f,Line ,Polyline, PolyCurve, Curve, PolylineCurve, NurbsCurve,LineCurve,Ellipse,Arc,Circle,ArcCurve
import RhinoInside.Revit.Convert.Geometry
clr.ImportExtensions(RhinoInside.Revit.Convert.Geometry)



def get_active_doc():
    return Revit.ActiveDBDocument

def get_active_ui_doc():
    return Revit.ActiveUIDocument

def convert_rhino_to_revit_length(rhino_length):
    return Convert.Geometry.GeometryEncoder.ToInternalLength(rhino_length)

def convert_revit_to_rhino_length(revit_length):
    return Convert.Geometry.GeometryDecoder.ToModelLength(revit_length)

def convert_rhino_to_revit_geometry(rhino_geometry):
    geometry_type = type(rhino_geometry)
    print(geometry_type)
    if geometry_type is Point3d or \
        geometry_type is Point3f or \
        geometry_type is Vector3d or \
        geometry_type is Vector3f:
            return rhino_geometry.ToXYZ()
    elif geometry_type is Ellipse or \
        geometry_type is LineCurve or \
        geometry_type is NurbsCurve or \
        geometry_type is PolyCurve or \
        geometry_type is PolylineCurve or \
        geometry_type is Curve or \
        geometry_type is ArcCurve:
            return rhino_geometry.ToCurve()
    elif geometry_type is Polyline:
        return rhino_geometry.ToPolyLine()
    elif geometry_type is Line:
        return rhino_geometry.ToLine()
    elif geometry_type is Arc or\
        geometry_type is Circle:
            return rhino_geometry.ToArc()
    else:
        raise ValueError("Unsupported geometry type: {0}".format(geometry_type))
def convert_revit_to_rhino_geometry(revit_geometry):
    geometry_type = type(revit_geometry)
    print(geometry_type)
    if geometry_type is BoundingBoxXYZ:
            return revit_geometry.ToBox()
    elif geometry_type is RevitArc or \
        geometry_type is RevitCurve or \
        geometry_type is CurveLoop or \
        geometry_type is RevitLine or \
        geometry_type is CylindricalHelix or \
        geometry_type is NurbSpline or \
        geometry_type is HermiteSpline:
            return revit_geometry.ToCurve()
    elif geometry_type is CurveArray or \
        geometry_type is CurveArrArray:
            return revit_geometry.ToCurveMany()
    elif geometry_type is XYZ:
            return revit_geometry.ToPoint3d()
    else:
        raise ValueError("Unsupported geometry type: {0}".format(geometry_type))
        
     
a = get_active_doc()
# ---------- end python_3 ----------
python_4 = GhPythonScript()  # -> out, a
# ---------- python_4: Python ----------
from utils.rhinoinside_utils import get_active_doc

a = get_active_doc()
# ---------- end python_4 ----------
pt_2 = Point(<point referenced from the Rhino model>)
hframes = HorizontalFrames(Curve=crv, Count=10)  # -> Frames, Parameters
python_5 = GhPythonScript(dict=python.a)  # -> out, familyType, blockName, category
# ---------- python_5: Python ----------
__author__ = "ykish"
__version__ = "2023.11.29"

import rhinoscriptsyntax as rs

category = dict['BuiltInCategory']
familyType = dict['FamilyType']
blockName = dict['BlockName']
# ---------- end python_5 ----------
panel_2 = Panel(python_3.a)
panel_3 = Panel(python_4.a)
python_6 = GhPythonScript(point=pt, blockname=panel)  # -> out, a; inputs point: Point3d
# ---------- python_6: Python ----------
import clr
clr.AddReference('RevitAPI')
from Autodesk.Revit.DB.Structure import StructuralType
from Autodesk.Revit.DB import BuiltInCategory,FilteredElementCollector,FamilySymbol,BuiltInParameter,XYZ,Transaction
from utils.rhinoinside_utils import get_active_doc
from repository.data_processor import find_row_by_name
from utils.rhinoinside_utils import get_active_doc, convert_rhino_to_revit_geometry

def get_built_in_category(category_name):
    try:
        # 文字列からBuiltInCategoryを取得
        category = getattr(BuiltInCategory, category_name)
        return category
    except Exception as e:
        # カテゴリが見つからない場合はNoneを返す
        return None
        
def query_family_symbol(doc, category, type_name):
    # 指定されたカテゴリとタイプ名に基づいてFamily Typeを取得
    collector = FilteredElementCollector(doc).OfClass(FamilySymbol).OfCategory(category)
    for elem in collector:
        if elem.get_Parameter(BuiltInParameter.ALL_MODEL_TYPE_NAME).AsString() == type_name:
            return elem
    return None
    
def place_family_instance(doc, family_symbol, position):
    # FamilyInstanceを配置するためのトランザクションを開始
    transaction = Transaction(doc, "Place Family Instance")
    transaction.Start()

    try:
        # FamilyInstanceを配置
        instance = doc.Create.NewFamilyInstance(position, family_symbol, StructuralType.NonStructural)
        transaction.Commit()
        return instance
    except Exception as e:
        print(e)
        transaction.RollBack()
        return None
        

famiytypename = find_row_by_name(_blockname,'BlockName')[0]['FamilyType']
category_name = find_row_by_name(_blockname,'BlockName')[0]['BuiltInCategory']
print(famiytypename)
print(category_name)

category = get_built_in_category(category_name)
doc = get_active_doc()

family_symbol = query_family_symbol(doc,category,famiytypename)
print(family_symbol.get_Parameter(BuiltInParameter.ALL_MODEL_TYPE_NAME).AsString())
position = convert_rhino_to_revit_geometry(_point)
desk = place_family_instance(doc, family_symbol, position)

print(desk)
# ---------- end python_6 ----------
python_7 = GhPythonScript(point=pt_2, blockname="Desk", bake=Toggle(True))  # -> out, a; inputs point: Point3d, bake: Boolean
# ---------- python_7: Python ----------
from revit.create_familyInstance import place_family_instance_by_name_and_point,rotate_family_instance_by_plane
if _bake:
    familyInstance = place_family_instance_by_name_and_point(_blockname, _point)
# ---------- end python_7 ----------
python_8 = GhPythonScript(plane=hframes.Frames, blockname="Chair", bake=Toggle(True))  # -> out, familyInstance, preview; inputs plane: Plane, bake: Boolean
# ---------- python_8: Python ----------
from revit.create_familyInstance import place_family_instance_by_name_and_plane
from geometry.geometry import preview_block_instance
if _bake:
    familyInstance = place_family_instance_by_name_and_plane(_blockname, _plane)
preview = preview_block_instance(_blockname, _plane)
# ---------- end python_8 ----------
preview = GhPythonScript(block_name="Chair", plane=hframes.Frames)  # -> out, a
# ---------- preview: Python ----------
__author__ = "ykish"
__version__ = "2023.12.01"

import Rhino
import scriptcontext as sc
import System

def preview_block_instance(block_name, plane):
    # ブロック定義を名前で取得
    block_definition = Rhino.RhinoDoc.ActiveDoc.InstanceDefinitions.Find(block_name)
    if not block_definition:
        print("Block definition not found.")
        return None

    # ブロックのジオメトリを取得して平面に変換
    transformed_geometries = []
    for obj in block_definition.GetObjects():
        geom = obj.Geometry
        if geom:  # ジオメトリが存在する場合
            transformed_geom = geom.Duplicate()  # ジオメトリのコピー
            transform = Rhino.Geometry.Transform.PlaneToPlane(Rhino.Geometry.Plane.WorldXY, plane)
            transformed_geom.Transform(transform)
            transformed_geometries.append(transformed_geom)

    return transformed_geometries


geometries = preview_block_instance(_block_name, _plane)

# Grasshopperの出力にジオメトリをセット
a = geometries
# ---------- end preview ----------
panel_4 = Panel(python_5.familyType)
panel_5 = Panel(python_5.blockName)
pt_3 = Point(<point referenced from the Rhino model>)
pt_4 = Point(<point referenced from the Rhino model>)
pt_5 = Point(<point referenced from the Rhino model>)
crv_2 = Curve(<curve referenced from the Rhino model>)
python_9 = GhPythonScript(x=pt_3)  # -> out, a; inputs x: Point3d
# ---------- python_9: Python ----------
import clr
clr.AddReference('RhinoInside.Revit')
clr.AddReference('System.Core')
clr.AddReference('RevitAPI') 
clr.AddReference('RevitAPIUI')
from RhinoInside.Revit import Revit, Convert
from Autodesk.Revit import DB
from System.Collections.Generic import List, IList
from System import Enum, Action, Func, Uri, Guid, DateTime
from Autodesk.Revit.DB import XYZ, Line as RevitLine, CurveArray, CurveArrArray,NurbSpline,BoundingBoxXYZ, Arc as RevitArc,Curve as RevitCurve,CurveLoop,CylindricalHelix, Ellipse as RevitEllipse,HermiteSpline 
from Rhino.Geometry import Arc, Circle,Point3d,Point3f, Vector3d,Vector3f,Line ,Polyline, PolyCurve, Curve, PolylineCurve, NurbsCurve,LineCurve,Ellipse,Arc,Circle,ArcCurve
import RhinoInside.Revit.Convert.Geometry
clr.ImportExtensions(RhinoInside.Revit.Convert.Geometry)



def get_active_doc():
    return Revit.ActiveDBDocument

def get_active_ui_doc():
    return Revit.ActiveUIDocument

def convert_rhino_to_revit_length(rhino_length):
    return Convert.Geometry.GeometryEncoder.ToInternalLength(rhino_length)

def convert_revit_to_rhino_length(revit_length):
    return Convert.Geometry.GeometryDecoder.ToModelLength(revit_length)

def convert_rhino_to_revit_geometry(rhino_geometry):
    geometry_type = type(rhino_geometry)
    print(geometry_type)
    if geometry_type is Point3d or \
        geometry_type is Point3f or \
        geometry_type is Vector3d or \
        geometry_type is Vector3f:
            return rhino_geometry.ToXYZ()
    elif geometry_type is Ellipse or \
        geometry_type is LineCurve or \
        geometry_type is NurbsCurve or \
        geometry_type is PolyCurve or \
        geometry_type is PolylineCurve or \
        geometry_type is Curve or \
        geometry_type is ArcCurve:
            return rhino_geometry.ToCurve()
    elif geometry_type is Polyline:
        return rhino_geometry.ToPolyLine()
    elif geometry_type is Line:
        return rhino_geometry.ToLine()
    elif geometry_type is Arc or\
        geometry_type is Circle:
            return rhino_geometry.ToArc()
    else:
        raise ValueError("Unsupported geometry type: {0}".format(geometry_type))
def convert_revit_to_rhino_geometry(revit_geometry):
    geometry_type = type(revit_geometry)
    print(geometry_type)
    if geometry_type is BoundingBoxXYZ:
            return revit_geometry.ToBox()
    elif geometry_type is RevitArc or \
        geometry_type is RevitCurve or \
        geometry_type is CurveLoop or \
        geometry_type is RevitLine or \
        geometry_type is CylindricalHelix or \
        geometry_type is NurbSpline or \
        geometry_type is HermiteSpline:
            return revit_geometry.ToCurve()
    elif geometry_type is CurveArray or \
        geometry_type is CurveArrArray:
            return revit_geometry.ToCurveMany()
    elif geometry_type is XYZ:
            return revit_geometry.ToPoint3d()
    else:
        raise ValueError("Unsupported geometry type: {0}".format(geometry_type))
        
     
a = convert_rhino_to_revit_geometry(x)
# ---------- end python_9 ----------
python_10 = GhPythonScript(x=pt_4)  # -> out, a; inputs x: Point3d
# ---------- python_10: Python ----------
from utils.rhinoinside_utils import convert_rhino_to_revit_geometry

a = convert_rhino_to_revit_geometry(x)
# ---------- end python_10 ----------
graphical_element = GraphicalElement(<familyinstance referenced from the Revit model>)

# ----
# Color Format
# Input
data = Data(1)
# Method
data_2 = Data(1)
# Output
data_3 = Data(1)
# Display
data_4 = Data(1)
# Unuse
data_5 = Data(1)

python_11 = GhPythonScript(plane=hframes.Frames, blockname="Desk", bake=Toggle(False))  # -> out, a; inputs plane: Plane, bake: Boolean
# ---------- python_11: Python ----------
from revit.create_familyInstance import place_family_instance_by_name_and_point,rotate_family_instance_by_plane
if _bake:
    point = _plane.Origin
    familyInstance = place_family_instance_by_name_and_point(_blockname, point)
    rotate_family_instance_by_plane(familyInstance,_plane)
# ---------- end python_11 ----------
python_12 = GhPythonScript(curve=crv_2)  # -> out, a; inputs curve: Curve
# ---------- python_12: Python ----------
__author__ = "ykish"
__version__ = "2023.12.01"

from utils.rhinoinside_utils import convert_rhino_to_revit_geometry

a = convert_rhino_to_revit_geometry(_curve)
# ---------- end python_12 ----------
python_13 = GhPythonScript()  # -> out, a
# ---------- python_13: Python ----------
__author__ = "ykish"
__version__ = "2023.12.01"

from repository.data_processor import find_row_by_name

a = find_row_by_name('Desk','BlockName')
# ---------- end python_13 ----------
panel_6 = Panel(python_9.a)
panel_7 = Panel(python_10.a)
python_14 = GhPythonScript(dict=python_13.a)  # -> out, a
# ---------- python_14: Python ----------
__author__ = "ykish"
__version__ = "2023.12.01"

import rhinoscriptsyntax as rs

a = _dict['BuiltInCategory']
# ---------- end python_14 ----------
panel_8 = Panel(python_12.a)
pt_6 = Point(<point referenced from the Rhino model>)
panel_9 = Panel(python_14.a)
python_15 = GhPythonScript(point=pt_6, blockname="Desk")  # -> out, a; inputs point: Point3d
# ---------- python_15: Python ----------
__author__ = "ykish"
__version__ = "2023.12.01"

from revit.create_familyInstance import place_family_instance_by_name_and_point

a = place_family_instance_by_name_and_point(_blockname, _point)
# ---------- end python_15 ----------
